% Simulink data dictionary TUM_interfaces.sldd

CartPos = Simulink.Bus()
  x_m: double
  y_m: double
  psi_rad: double

PathPos = Simulink.Bus()
  s_m: double
  d_m: double
  psi_rad: double

SpeedVec = Simulink.Bus()
  vx: double
  vy: double
  beta: double

TUMHealthStatus = enum(DefaultValue="ERROR", StorageType="uint16")
  ERROR = 0
  WARNING = 1
  OK = 2

IC_TUMModeControl = struct(
  TUMVehicleState=TUMVehicleState.OFF,
  EnableSensorFusion=false,
  EnableControlOutputs=false,
  EnableDriver=false)

TUMControlState = enum(DefaultValue="Standstill")
  Standstill = 0
  Slow = 1
  Fast = 2
  Emergency = 3
  Brake = 4

mvdc_traj_gen_debug = Simulink.Bus()
  delta_kappa_radpm: double
  kappa_radpm_actual: double
  kappa_radpm_next: double
  kappaFFModel_radpm: double
  kappaFFLMS_radpm: double

StateEstimation_state = Simulink.Bus()
  Pos: Bus: CartPos
  dPsi_radps: double
  vx_mps: double
  vy_mps: double
  ax_mps2: double
  ay_mps2: double

Odometry = Simulink.Bus()
  Position: Bus: CartPos
  Valid_b: boolean

VisualLoc_Send = Simulink.Bus()
  timeGPS_s: double
  vx_mps: double
  vy_mps: double
  dPsi_radps: double
  ResetPosition: Bus: CartPos
  ResetPosition_Valid: boolean
  Odometry: Bus: Odometry

TUMOdometryEstimationState = enum(DefaultValue="OE_OFF")
  OE_OFF = 0
  OE_NOTVALID = 1
  OE_VALID = 2

TUMStateEstimationState = enum(DefaultValue="SE_OFF")
  SE_OFF = 0
  SE_NOTVALID = 1
  SE_VEHICLE_GPS_VALID = 2
  SE_VEHICLE_VLOC_VALID = 3
  SE_VEHICLE_GPS_VLOC_VALID = 4

mvdc_trajectory_driver_perf = Simulink.Bus()
  LapTime_s: double
  e_lateral_m: double
  eRMS_lateral_m: double
  ePeak_lateral_m: double
  e_heading_rad: double
  eRMS_heading_rad: double
  ePeak_heading_rad: double
  e_v_mps: double
  eRMS_v_mps: double
  ePeak_v_mps: double
  e_kappa_radpm: double
  eRMS_kappa_radpm: double
  ePeak_kappa_radpm: double
  eControlRMS_v_mps: double
  eControlPeak_v_mps: double
  eControlRMS_kappa_radpm: double
  eControlPeak_kappa_radpm: double

mvdc_trajectory_driver_debug_all = Simulink.Bus()
  mvdc_path_feedback_debug: Bus: mvdc_path_feedback_debug
  mvdc_path_matching_debug: Bus: mvdc_path_matching_debug
  mvdc_trajectory_driver_debug: Bus: mvdc_trajectory_driver_debug
  mvdc_trajectory_driver_perf: Bus: mvdc_trajectory_driver_perf

Localization_PX2Debug = Simulink.Bus()
  xGPS_m: double
  yGPS_m: double
  xVLOCraw_m: double
  yVLOCraw_m: double
  xVLOC_m: double
  yVLOC_m: double
  xEstimate_m: double
  yEstimate_m: double
  xPath_m: double
  yPath_m: double

PathPoint = Simulink.Bus()
  LapCnt: uint32
  TrajCnt: uint32
  s_m: double
  x_m: double
  y_m: double
  psi_rad: double
  kappa_radpm: double
  kappaFF_radpm: double
  v_mps: double
  ax_mps2: double
  axFF_mps2: double
  Delta_rad: double
  DriveForce_N: double

mvdc_vehicle_dynamics_control_debug = Simulink.Bus()
  mvdc_path_feedback_debug: Bus: mvdc_path_feedback_debug
  mvdc_path_matching_debug: Bus: mvdc_path_matching_debug
  mvdc_trajectory_driver_debug: Bus: mvdc_trajectory_driver_debug
  mvdc_trajectory_driver_perf: Bus: mvdc_trajectory_driver_perf
  mvdc_state_estimation_debug: Bus: mvdc_state_estimation_debug
  mvdc_curvvel_tracking_debug: Bus: mvdc_curvvel_tracking_debug
  mloc_statemachine_debug: Bus: mloc_statemachine_debug
  mloc_diag_vehicle_debug: Bus: mloc_diag_vehicle_debug
  VehicleSensorData: Bus: VehicleSensorData
  Time_s: double

ActuatorLimitations = Simulink.Bus()
  SteeringAngleMax_rad: double
  SteeringAngleMin_rad: double
  DriveForceMax_N: double
  DriveForceMin_N: double

TUMModeControl = Simulink.Bus()
  TUMVehicleState: Enum: TUMVehicleState
  EnableSensorFusion: boolean
  EnableControlOutputs: boolean
  EnableDriver: boolean
  EnableHardEmergencyBrake: boolean
  RequestControl: boolean

VehicleSystemStatus = Simulink.Bus()
  Hardware: Enum: TUMHealthStatus
  AIDriver: Enum: TUMHealthStatus
  AIDriverStartup: Enum: TUMHealthStatus
  VehicleReady2Drive: boolean

VehicleControl = Simulink.Bus()
  RequestSteeringAngle_rad: double
  RequestLongForce_N: double
  ParkBrakeActive: boolean

VehicleActuatorStatus = Simulink.Bus()
  VehicleReady: boolean
  HardwareStatus: Enum: TUMHealthStatus

mvdc_state_estimation_debug = Simulink.Bus()
  StateEstimate: Bus: VehicleDynamicState
  Residuals: Bus: StateEstimation_residuals
  Covariances: Bus: StateEstimation_covariances

StateEstimation_residuals = Simulink.Bus()
  res_xGPS_m: double
  res_yGPS_m: double
  res_PsiGPS_rad: double
  res_xVLOC_m: double
  res_yVLOC_m: double
  res_PsiVLOC_rad: double
  res_vx_mps: double
  res_vy_mps: double
  res_dPsi_radps: double
  res_sGPS_m: double
  res_dGPS_m: double
  res_sVLOC_m: double
  res_dVLOC_m: double

V2X_Vehicle = Simulink.Bus()
  x_m: double
  y_m: double
  psi_rad: double
  vx_mps: double
  vy_mps: double
  dPsi_radps: double

V2X_Data = Simulink.Bus()
  Op1: V2X_Vehicle
  Op2: V2X_Vehicle
  Op3: V2X_Vehicle
  Op4: V2X_Vehicle

mvdc_path_matching_debug = Simulink.Bus()
  PathSmooth_RMSError_m: double
  PathSmooth_PeakError_m: double
  LocalPos: Bus: CartPos
  LocalPsiVel_rad: double
  PathPos: Bus: PathPos
  ActualPathPoint: Bus: PathPoint
  DeltaTPathUpdate_s: double

StateEstimation_covariances = Simulink.Bus()
  x_m2: double
  y_m2: double
  psi_rad2: double
  vx_m2ps2: double
  vy_m2ps2: double
  dPsi_rad2ps2: double
  s_m2: double
  d_m2: double

TUMStrategyState = enum(DefaultValue="S_OFF", StorageType="uint16")
  S_OFF = 0
  S_STARTUP = 10
  S_STANDSTILL = 20
  S_STANDSTILL_TRAJSEND = 25
  S_DRIVING_NORMAL = 30
  S_DRIVING_BRAKE2STOP = 40
  S_DRIVING_EMERGENCY = 50

VisualLoc = Simulink.Bus()
  CartPos: Bus: CartPos
  GPSTime_s: double
  VLOCCommsStatus: Enum: TUMHealthStatus
  Estimate_OK: uint16
  LeftDistance_m: double
  RightDistance_m: double
  BarriersCommsStatus: Enum: TUMHealthStatus

Planning_ControlPerformance_Feedback = Simulink.Bus()
  scale_factor: double
  v_max_mps: double

mloc_diag_vehicle_debug = Simulink.Bus()
  BarriersEmergencyDetected_b: boolean
  VehicleUnstable_b: boolean
  VehicleUnresponsive_b: boolean

mvdc_path_feedback_debug = Simulink.Bus()
  BarriersL_x_m: double
  BarriersL_y_m: double
  BarriersR_x_m: double
  BarriersR_y_m: double
  LeftDistance_m: double
  RightDistance_m: double
  Lat_FB_Barriers: double
  Lat_FB_Sum_KappaReq_radpm: double
  Lat_FB_Position: double
  Lat_FB_Heading: double
  Lat_LatPosError_m: double
  Lat_LatPosError_DerAna_mps: double
  Lat_LatPosError_DerNum_mps: double
  Lat_FF_Kappa_KappaReq_radpm: double
  Lat_FF_FIR_radpm: double
  Lat_all_KappaReq_radpm: double

TargetValuesVehicleDynamics = Simulink.Bus()
  v_mps: double
  ax_mps2: double
  ManualFF_DriveForce_N: double
  kappa_radpm: double
  kappaFF_radpm: double
  ManualFF_Delta_rad: double
  EnableDriving: boolean
  EnableEmergency: boolean

TUMPathMatchingState = enum(DefaultValue="PM_OFF")
  PM_OFF = 0
  PM_NOTVALID = 1
  PM_VALID = 2
  PM_VALID_HIGHDEVIATION = 3
  PM_ENDREACHED = 4

mvdc_trajectory_driver_debug = Simulink.Bus()
  DriverStatus: uint16
  EnablePathMatching: boolean
  EnableDriving: boolean
  PathMatchingStatus: uint16
  Strategy_Status: uint16
  Trajectories_CommsStatus: Enum: TUMHealthStatus
  Strategy_CommsStatus: Enum: TUMHealthStatus

VehicleControlDisturbances = Simulink.Bus()
  kappaDist_radpm: double
  axDist_mps2: double

mvdc_curvvel_tracking_debug = Simulink.Bus()
  Curv_all_KappaReq_radpm: double
  Curv_FB_Dist_DeltaReq_rad: double
  Curv_FB_Diff_DeltaReq_rad: double
  Curv_FF_Kappa_DeltaReq_rad: double
  Curv_CurvError_radpm: double
  Curv_TargetCurv_radpm: double
  Long_FB_Dist_FxReq_N: double
  Long_FF_Dist_FxReq_N: double
  Long_FB_VelDiff_FxReq_N: double
  Long_FF_Traj_FxReq_N: double
  Long_VelError_mps: double
  Long_TargetSpeed_mps: double
  Long_axTarget_mps2: double
  CO: Bus: VehicleControl
  ControlState: uint16
  EnableDriving: boolean
  EnableEmergency: boolean

ControlErrors = Simulink.Bus()
  e_LateralDeviation_m: double
  de_LateralDeviationDer_mps: double
  ePsi_HeadingDeviation_rad: double
  u_ControlInput_radpm: double

ControllerLearning_Send = Simulink.Bus()
  VehicleDynamicState: Bus: VehicleDynamicState
  ControlErrors: Bus: ControlErrors
  MeasurementIdx: uint32

ControllerParameter = Simulink.Bus()
  FeedbackParam: double[4]
  FeedforwardParam: double[501]
  CommsStatus: Enum: TUMHealthStatus

UDPPackages_Rcv = Simulink.Bus()
  BSM_Package: uint8[4]
  BSM_Valid: boolean
  EmergencyTrajectory_Package: uint8[1412]
  EmergencyTrajectory_Valid: boolean
  PerformanceTrajectory_Package: uint8[1412]
  PerformanceTrajectory_Valid: boolean
  VLOC_Package: uint8[48]
  VLOC_Valid: boolean
  VisualBounds_Package: uint8[24]
  VisualBounds_Valid: boolean
  ControllerParam_Package: uint8[1019]
  ControllerParam_Valid: boolean

mloc_statemachine_debug = Simulink.Bus()
  Hardware_Status: uint16
  AIDriver_Status: uint16
  AIDriverStartup_Status: uint16
  VehicleReady2Drive: uint16
  StateEstimation_Status: uint16
  VehicleSafeStandstill: uint16
  Driver_Status: uint16
  VehicleUnresponsive: uint16
  TUMVehicleState: uint16
  EnableSensorFusion: uint16
  EnableControlOutputs: uint16
  EnableDriver: uint16
  EnableHardEmergencyBrake: uint16
  RequestControl: uint16

TUMVehicleState = enum(DefaultValue="OFF", StorageType="uint16")
  STARTUP_Init = 10
  STARTUP_WaitForSystem = 11
  STARTUP_WaitForAIDriverComms = 12
  IDLE_ActivateSensorFusion = 20
  IDLE_WaitForSensorFusion = 21
  IDLE_ActivateDriver = 22
  IDLE_WaitForDriver = 23
  IDLE_WaitForVehicle = 24
  DRIVING = 30
  EMERGENCY = 50
  HARDEMERGENCY = 60
  OFF = 0

Trajectory = Simulink.Bus()
  LapCnt: uint32
  TrajCnt: uint32
  delay_s: double
  s_m: single[50]
  x_m: single[50]
  y_m: single[50]
  psi_rad: single[50]
  kappa_radpm: single[50]
  v_mps: single[50]
  ax_mps2: single[50]
  Delta_rad: single[50]
  DriveForce_N: single[50]

TrajectoryPlanning = Simulink.Bus()
  Strategy_Status: Enum: TUMStrategyState
  Strategy_CommsStatus: Enum: TUMHealthStatus
  Trajectories_CommsStatus: Enum: TUMHealthStatus
  EmergencyTrajectory: Bus: Trajectory
  PerformanceTrajectory: Bus: Trajectory

VehicleSensorData = Simulink.Bus()
  Tz_Powertrain_Nm: double
  Fx_Powertrain_N: double
  T_WheelFL_Nm: double
  T_WheelFR_Nm: double
  T_WheelRL_Nm: double
  T_WheelRR_Nm: double
  omega_WheelFL_radps: double
  omega_WheelFR_radps: double
  omega_WheelRL_radps: double
  omega_WheelRR_radps: double
  Delta_Wheel_rad: double
  p_BrakeF_bar: double
  p_BrakeR_bar: double
  x_VLOC_m: double
  y_VLOC_m: double
  psi_VLOC_rad: double
  BarriersDistanceL_m: double
  BarriersDistanceR_m: double
  BarriersValid_b: boolean
  tGPSEstimateVLOC_s: double
  VLOCPosValid_b: boolean
  VLOCLocAccuracy: double[3]
  x_GPS_m: double
  y_GPS_m: double
  z_GPS_m: double
  tGPSEstimateGPS_s: double
  GPSPosValid_b: boolean
  GPSLocAccuracy: double[3]
  ax_CoG_mps2: double
  ay_CoG_mps2: double
  az_CoG_mps2: double
  dPhi_RollRate_radps: double
  dTheta_PitchRate_radps: double
  dPsi_YawRate_radps: double
  phi_RollAngle_rad: double
  theta_PitchAngle_rad: double
  psi_YawAngle_rad: double
  Beta_CoG_rad: double
  vx_CoG_mps: double
  vy_CoG_mps: double

VehicleDynamicState = Simulink.Bus()
  SEOk: boolean
  SEStatus: Enum: TUMStateEstimationState
  VEStatus: Enum: TUMOdometryEstimationState
  Pos: Bus: CartPos
  z_m: double
  PosAccuracy: double[3]
  VelAccuracy: double[3]
  dPsi_radps: double
  vx_mps: double
  vy_mps: double
  v_mps: double
  beta_rad: double
  ax_mps2: double
  ay_mps2: double
  psi_vel_rad: double
  kappa_radpm: double
  dBeta_radps: double
  ddPsi_radps2: double
  ax_vel_mps2: double
  ay_vel_mps2: double
  lambdaFL_perc: double
  lambdaFR_perc: double
  lambdaRL_perc: double
  lambdaRR_perc: double
  alphaFL_rad: double
  alphaFR_rad: double
  alphaRL_rad: double
  alphaRR_rad: double

UDPPackages_Send = Simulink.Bus()
  BSM_Package: uint8[8]
  BSM_ActivateSend: boolean
  TG_Package: uint8[24]
  TG_ActivateSend: boolean
  VLOC_Package: uint8[96]
  VLOC_ActivateSend: boolean
  ControllerLearning_Package: uint8[116]
  ControllerLearning_ActivateSend: boolean
  StateEstimate_Package: uint8[89]
  StateEstimate_ActivateSend: boolean