% Simulink data dictionary modelconfig.sldd

tS_RasperryPi = 0.02
Speedgoat = Simulink.ConfigSet(StartTime="0", StopTime="inf", FixedStep="tS", Solver="FixedStepDiscrete", ProdHWDeviceType="Generic->32-bit x86 compatible", SystemTargetFile="slrt.tlc", TargetLang="C")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
tSV2X = Simulink.Parameter(0.002)
tS_Speedgoat = 0.01
tS_ERT = Simulink.Parameter(0.01)
ERT = Simulink.ConfigSet(StartTime="0", StopTime="inf", FixedStep="tS", Solver="FixedStepDiscrete", ProdHWDeviceType="Intel->x86-64 (Windows64)", SystemTargetFile="ert.tlc", TargetLang="C++")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
tSSlow = 0.04
Active = Simulink.ConfigSet(StartTime="0", StopTime="inf", FixedStep="tS", Solver="FixedStepDiscrete", ProdHWDeviceType="Intel->x86-64 (Windows64)", SystemTargetFile="ert.tlc", TargetLang="C++")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
tS = Simulink.Parameter(0.01)