% Simulink data dictionary pa_vehicleparameter.sldd

WheelInertia_Front_kgm2 = 2
roh_air = Simulink.Parameter(1.22)
A_VehicleReference_m2 = Simulink.Parameter(1)
P_VDC_MinVelSlipCalc_mps = Simulink.Parameter(3)
cL_front = 1
cL_rear = 1.2
cog_x = 1.4
cog_y = 0
drag_coefficient = 2.3
gearratio = 4
l_front_m = 1.4
l_rear_m = 2
tw_front_m = 1.7
tw_rear_m = 1.7
tyre_width_F = 0.4
tyre_width_R = 0.4
tyreradius_front_m = 0.42
tyreradius_rear_m = 0.42
vehicleinertia_kgm2 = 1500
vehiclemass_kg = 1300
WheelInertia_Rear_kgm2 = 2
cog_z = 0.4